# Dynamo graph Portal_sample.dyn (Dynamo 0.7.3.3034)

create = List.Create()
number = DoubleInput(4)
number_2 = DoubleInput(4)
number_3 = DoubleInput(5)
number_4 = DoubleInput(0)
number_5 = DoubleInput(300)
number_6 = DoubleInput(500)
number_7 = DoubleInput(350)
xyzGrid = Custom[XyzGrid](x_count=number, y_count=number_2, z_count=number_3, x0=number_4, y0=number_4, z0=number_4, x_space=number_5, y_space=number_6, z_space=number_7)  # This node represents an upgrade of the 0.6.3 XyzGrid node to 0.7.x
flatten = Flatten(xyzGrid)
formula = Formula("x*y;", x=number, y=number_2)
chop = List.Chop(flatten, formula)
number_8 = DoubleInput(1)
formula_2 = Formula("z-1", z=number_3)
number_sequence = NumberSeq(number_8, formula_2, number_8, lacing=Longest)
getItemAtIndex = List.GetItemAtIndex(chop, number_sequence)
flatten_2 = Flatten(getItemAtIndex)
chop_2 = List.Chop(flatten_2, number)
chop_3 = List.Chop(chop_2, number_2)
byPoints = PolyCurve.ByPoints(chop_3)
explode = Geometry.Explode(byPoints)
flatten_3 = Flatten()
map = List.Map(explode, flatten_3)
number_9 = DoubleInput(0)
code_block = CodeBlock(x=number, y=number_2) { x*y; }
number_sequence_2 = NumberSeq(number_9, formula_2, code_block, lacing=Longest)
number_10 = DoubleInput(1)
number_sequence_3 = NumberSeq(number_sequence_2, number, number_10, lacing=Longest)
number_sequence_4 = NumberSeq(number_sequence_3, number_2, number, lacing=Longest)
getItemAtIndex_2 = List.GetItemAtIndex(flatten_2, number_sequence_4)
byPoints_2 = PolyCurve.ByPoints(getItemAtIndex_2)
explode_2 = Geometry.Explode(byPoints_2)
map_2 = List.Map(explode_2, flatten_3)
combine = List.Combine(create, map, map_2)
integer_slider = IntegerSlider(1, range=0..4)
getItemAtIndex_3 = List.GetItemAtIndex(combine, integer_slider)
flatten_4 = Flatten(combine)
code_block_2 = CodeBlock { "Steel"; }
fromLine = DynamoSAP.Structure.Frame.FromLine(flatten_4, code_block_2)
transpose = List.Transpose(chop)
byPoints_3 = PolyCurve.ByPoints(transpose)
explode_3 = Geometry.Explode(byPoints_3)
flatten_5 = Flatten(explode_3)
startPoint = Curve.StartPoint(flatten_5)
endPoint = Curve.EndPoint(flatten_5)
code_block_3 = CodeBlock { "HSS12x8x1/4"; }
fromEndPoints = DynamoSAP.Structure.Frame.FromEndPoints(startPoint, endPoint, code_block_2, code_block_3)
startPoint_2 = Curve.StartPoint(flatten_4)
endPoint_2 = Curve.EndPoint(flatten_4)
code_block_4 = CodeBlock { "W12x40"; }
fromEndPoints_2 = DynamoSAP.Structure.Frame.FromEndPoints(startPoint_2, endPoint_2, code_block_2, code_block_4)
create_2 = List.Create(fromEndPoints, fromEndPoints_2)
flatten_6 = Flatten(create_2)
code_block_5 = CodeBlock { "LiveLoadSample"; }
loadPatternTypeDropDown = LoadPatternTypeDropDown("LTYPE_LIVE")
number_11 = DoubleInput(1.25)
setLoadPattern = DynamoSAP.Analysis.LoadPattern.SetLoadPattern(code_block_5, loadPatternTypeDropDown, number_11)
create_3 = List.Create(setLoadPattern)
flatten_7 = Flatten(create_3)
code_block_6 = CodeBlock { "LoadCaseSample"; }
number_12 = DoubleInput(1.2)
create_4 = List.Create(number_12)
loadCaseTypeDropDown = LoadCaseTypeDropDown("CASE_NONLINEAR_STATIC")
setLoadCase = DynamoSAP.Analysis.LoadCase.SetLoadCase(code_block_6, create_3, create_4, loadCaseTypeDropDown)
create_5 = List.Create(setLoadCase)
flatten_8 = Flatten(create_5)
number_13 = DoubleInput(0)
getItemAtIndex_4 = List.GetItemAtIndex(chop, number_13)
takeItems = List.TakeItems(getItemAtIndex_4, number)
fixed = DynamoSAP.Analysis.Restraint.Fixed(takeItems)
dropItems = List.DropItems(getItemAtIndex_4, number)
roller = DynamoSAP.Analysis.Restraint.Roller(dropItems)
create_6 = List.Create(fixed, roller)
flatten_9 = Flatten(create_6)
createSAPModel = DynamoSAP.Assembly.SAPModel.CreateSAPModel(flatten_6, flatten_7, flatten_8, flatten_9)
boolean = BoolSelector(true)
code_block_7 = CodeBlock { "Global"; }
number_14 = DoubleInput(1)
integer_slider_2 = IntegerSlider(6, range=0..100)
double_slider = DoubleSlider(0.25, range=0..100)
double_slider_2 = DoubleSlider(0.75, range=0..100)
double_slider_3 = DoubleSlider(0, range=0..100)
distributedLoadOnFrame = DynamoSAP.Analysis.Load.DistributedLoadOnFrame(fromEndPoints_2, setLoadPattern, number_14, integer_slider_2, double_slider, double_slider_2, double_slider_3, double_slider_3)
create_7 = List.Create(distributedLoadOnFrame)
flatten_10 = Flatten(create_7)
setRelease = DynamoSAP.Analysis.Release.SetRelease(fromEndPoints_2)
create_8 = List.Create()
number_15 = DoubleInput(5)
number_16 = DoubleInput(6)
number_17 = DoubleInput(9)
number_18 = DoubleInput(10)
create_9 = List.Create(number_15, number_16, number_17, number_18)
getItemAtIndex_5 = List.GetItemAtIndex(explode_3, create_9)
transpose_2 = List.Transpose(getItemAtIndex_5)
endPoint_3 = Curve.EndPoint(transpose_2)
number_19 = DoubleInput(1)
number_20 = DoubleInput(2)
number_sequence_5 = NumberSeq(number_19, number_20, number_19, lacing=Longest)
getItemAtIndex_6 = List.GetItemAtIndex(arg1=number_sequence_5)
map_3 = List.Map(endPoint_3, getItemAtIndex_6)
flatten_11 = Flatten(map_3)
startPoint_3 = Curve.StartPoint(transpose_2)
number_21 = DoubleInput(0)
number_22 = DoubleInput(2)
number_23 = DoubleInput(3)
number_sequence_6 = NumberSeq(number_21, number_22, number_23, lacing=Longest)
getItemAtIndex_7 = List.GetItemAtIndex(arg1=number_sequence_6)
map_4 = List.Map(startPoint_3, getItemAtIndex_7)
flatten_12 = Flatten(map_4)
combine_2 = List.Combine(create_8, flatten_11, flatten_12)
flatten_13 = Flatten(combine_2)
number_24 = DoubleInput(4)
chop_4 = List.Chop(flatten_13, number_24)
boolean_2 = BoolSelector(true)
byPoints_4 = PolyCurve.ByPoints(chop_4, boolean_2)
explode_4 = Geometry.Explode(byPoints_4)
flatten_14 = Flatten(explode_4)
