# Dynamo graph Sample_3a_RunAnalysis_ReadResults.dyn (Dynamo 0.7.5.3566)

boolean = BoolSelector(true)
run = DynamoSAP.Analysis.Analysis.Run(boolean)
integer_slider = IntegerSlider(3, range=0..5)
getItemAtIndex = List.GetItemAtIndex(run.out2, integer_slider)
double_slider = DoubleSlider(1.078, range=0..2)
boolean_2 = BoolSelector(true)
double_slider_2 = DoubleSlider(2, range=0..2)
displayLoads = DynamoSAP.Structure.Frame.DisplayLoads(arg1=getItemAtIndex, arg2=double_slider, arg3=boolean_2, arg4=double_slider_2)
boolean_3 = BoolSelector(true)
getResults = DynamoSAP.Analysis.Analysis.GetResults(getItemAtIndex, boolean_3)
forceTypes = ForceTypes("Axial")
decomposeResults = DynamoSAP.Analysis.Analysis.DecomposeResults(arg1=getResults, arg2=forceTypes)
double_slider_3 = DoubleSlider(0.05, range=0..10)
visualizeResults = DynamoSAP.Analysis.Analysis.VisualizeResults(arg1=getResults, arg2=forceTypes, arg3=boolean_3, arg4=double_slider_3)
