# Dynamo graph portal_new version.dyn (Dynamo 0.7.5.3566)

boolean = BoolSelector(false)
run = DynamoSAP.Analysis.Analysis.Run(boolean)
integer_slider = IntegerSlider(3, range=0..5)
getItemAtIndex = List.GetItemAtIndex(run.out2, integer_slider)
double_slider = DoubleSlider(1.078, range=0..2)
boolean_2 = BoolSelector(true)
double_slider_2 = DoubleSlider(2, range=0..2)
displayLoads = DynamoSAP.Structure.Frame.DisplayLoads(run.out0, getItemAtIndex, double_slider, boolean_2, double_slider_2)
boolean_3 = BoolSelector(true)
getResults = DynamoSAP.Analysis.Analysis.GetResults(getItemAtIndex, boolean_3)
forceTypes = ForceTypes("Axial")
decomposeResults = DynamoSAP.Analysis.Analysis.DecomposeResults(run.out0, getResults, forceTypes)
double_slider_3 = DoubleSlider(0.05, range=0..10)
visualizeResults = DynamoSAP.Analysis.Analysis.VisualizeResults(run.out0, getResults, forceTypes, boolean_3, double_slider_3)
decompose = DynamoSAP.Assembly.StructuralModel.Decompose(run.out0)
decompose_2 = DynamoSAP.Structure.Frame.Decompose(decompose)
integer_slider_2 = IntegerSlider(4, range=0..100)
integer_slider_3 = IntegerSlider(5, range=0..100)
integer_slider_4 = IntegerSlider(5, range=0..100)
number = DoubleInput(0)
double_slider_4 = DoubleSlider(300, range=150..500)
double_slider_5 = DoubleSlider(500, range=150..500)
double_slider_6 = DoubleSlider(350, range=150..500)
xyzGrid = Custom[XyzGrid](x_count=integer_slider_2, y_count=integer_slider_3, z_count=integer_slider_4, x0=number, y0=number, z0=number, x_space=double_slider_4, y_space=double_slider_5, z_space=double_slider_6)  # This node represents an upgrade of the 0.6.3 XyzGrid node to 0.7.x
flatten = Flatten(xyzGrid)
formula = Formula("x*y;", x=integer_slider_2, y=integer_slider_3)
chop = List.Chop(flatten, formula)
transpose = List.Transpose(chop)
byPoints = PolyCurve.ByPoints(transpose)
explode = Geometry.Explode(byPoints)
# note: COLUMNS
flatten_2 = Flatten(explode)
startPoint = Curve.StartPoint(flatten_2)
endPoint = Curve.EndPoint(flatten_2)
sectionCatalogs = SectionCatalogs("AISC")
sections = DynamoSAP.Definitions.SectionProp.Sections(sectionCatalogs)
code_block = CodeBlock { 2; }
getItemAtIndex_2 = List.GetItemAtIndex(sections, code_block)
code_block_2 = CodeBlock { "Steel"; }
define = DynamoSAP.Definitions.SectionProp.Define(getItemAtIndex_2, code_block_2, sectionCatalogs)
# note: COLUMN FRAMES
fromEndPoints = DynamoSAP.Structure.Frame.FromEndPoints(startPoint, endPoint, define)
code_block_3 = CodeBlock { "Move_Load_Sample"; }
loadPatternTypes = LoadPatternTypes("LTYPE_MOVE")
number_2 = DoubleInput(0.75)
setLoadPattern = DynamoSAP.Definitions.LoadPattern.SetLoadPattern(code_block_3, loadPatternTypes, number_2)
type_1_force_2_moment = DoubleInput(1)
load_direction_4_x_5_y_6_z = IntegerSlider(5, range=0..100)
double_slider_7 = DoubleSlider(0.5, range=0..1)
integer_slider_5 = IntegerSlider(100, range=50..200)
# note: LOADS
pointLoadOnFrame = DynamoSAP.Definitions.Load.PointLoadOnFrame(setLoadPattern, type_1_force_2_moment, load_direction_4_x_5_y_6_z, double_slider_7, integer_slider_5)
# note: COLUMN FRAMES w/LOADS
setLoad = DynamoSAP.Structure.Frame.SetLoad(fromEndPoints, pointLoadOnFrame)
create = List.Create()
number_3 = DoubleInput(1)
formula_2 = Formula("z-1", z=integer_slider_4)
number_sequence = NumberSeq(number_3, formula_2, number_3, lacing=Longest)
getItemAtIndex_3 = List.GetItemAtIndex(chop, number_sequence)
flatten_3 = Flatten(getItemAtIndex_3)
chop_2 = List.Chop(flatten_3, integer_slider_2)
chop_3 = List.Chop(chop_2, integer_slider_3)
byPoints_2 = PolyCurve.ByPoints(chop_3)
explode_2 = Geometry.Explode(byPoints_2)
flatten_4 = Flatten()
map = List.Map(explode_2, flatten_4)
number_4 = DoubleInput(0)
code_block_4 = CodeBlock(x=integer_slider_2, y=integer_slider_3) { x*y; }
number_sequence_2 = NumberSeq(number_4, formula_2, code_block_4, lacing=Longest)
number_5 = DoubleInput(1)
number_sequence_3 = NumberSeq(number_sequence_2, integer_slider_2, number_5, lacing=Longest)
number_sequence_4 = NumberSeq(number_sequence_3, integer_slider_3, integer_slider_2, lacing=Longest)
getItemAtIndex_4 = List.GetItemAtIndex(flatten_3, number_sequence_4)
byPoints_3 = PolyCurve.ByPoints(getItemAtIndex_4)
explode_3 = Geometry.Explode(byPoints_3)
map_2 = List.Map(explode_3, flatten_4)
combine = List.Combine(create, map, map_2)
# note: BEAMS
flatten_5 = Flatten(combine)
startPoint_2 = Curve.StartPoint(flatten_5)
endPoint_2 = Curve.EndPoint(flatten_5)
# note: BEAM FRAMES
fromEndPoints_2 = DynamoSAP.Structure.Frame.FromEndPoints(startPoint_2, endPoint_2, define)
code_block_5 = CodeBlock { "Dead_Load_Sample"; }
loadPatternTypes_2 = LoadPatternTypes("LTYPE_DEAD")
number_6 = DoubleInput(1.6)
setLoadPattern_2 = DynamoSAP.Definitions.LoadPattern.SetLoadPattern(code_block_5, loadPatternTypes_2, number_6)
type_1_force_2_moment_2 = DoubleInput(1)
load_direction_4_x_5_y_6_z_2 = IntegerSlider(6, range=0..100)
double_slider_8 = DoubleSlider(0, range=0..100)
double_slider_9 = DoubleSlider(1, range=0..100)
double_slider_10 = DoubleSlider(-15, range=-100..0)
distributedLoadOnFrame = DynamoSAP.Definitions.Load.DistributedLoadOnFrame(setLoadPattern_2, type_1_force_2_moment_2, load_direction_4_x_5_y_6_z_2, double_slider_8, double_slider_9, double_slider_10, double_slider_10)
# note: BEAM FRAMES w/LOADS
setLoad_2 = DynamoSAP.Structure.Frame.SetLoad(fromEndPoints_2, distributedLoadOnFrame)
create_2 = List.Create()
number_7 = DoubleInput(5)
number_8 = DoubleInput(6)
number_9 = DoubleInput(9)
number_10 = DoubleInput(10)
create_3 = List.Create(number_7, number_8, number_9, number_10)
getItemAtIndex_5 = List.GetItemAtIndex(explode, create_3)
transpose_2 = List.Transpose(getItemAtIndex_5)
endPoint_3 = Curve.EndPoint(transpose_2)
number_11 = DoubleInput(1)
number_12 = DoubleInput(2)
number_sequence_5 = NumberSeq(number_11, number_12, number_11, lacing=Longest)
getItemAtIndex_6 = List.GetItemAtIndex(arg1=number_sequence_5)
map_3 = List.Map(endPoint_3, getItemAtIndex_6)
flatten_6 = Flatten(map_3)
startPoint_3 = Curve.StartPoint(transpose_2)
number_13 = DoubleInput(0)
number_14 = DoubleInput(2)
number_15 = DoubleInput(3)
number_sequence_6 = NumberSeq(number_13, number_14, number_15, lacing=Longest)
getItemAtIndex_7 = List.GetItemAtIndex(arg1=number_sequence_6)
map_4 = List.Map(startPoint_3, getItemAtIndex_7)
flatten_7 = Flatten(map_4)
combine_2 = List.Combine(create_2, flatten_6, flatten_7)
flatten_8 = Flatten(combine_2)
number_16 = DoubleInput(4)
chop_4 = List.Chop(flatten_8, number_16)
boolean_4 = BoolSelector(true)
byPoints_4 = PolyCurve.ByPoints(chop_4, boolean_4)
explode_4 = Geometry.Explode(byPoints_4)
# note: CORE DIAGONALS
flatten_9 = Flatten(explode_4)
startPoint_4 = Curve.StartPoint(flatten_9)
endPoint_4 = Curve.EndPoint(flatten_9)
# note: DIAGONAL FRAMES
fromEndPoints_3 = DynamoSAP.Structure.Frame.FromEndPoints(startPoint_4, endPoint_4, define)
boolean_5 = BoolSelector(true)
# note: RELEASE
set = DynamoSAP.Definitions.Release.Set(arg9=boolean_5, arg11=boolean_5)
# note: DIAGONAL FRAMES w/RELEASES
setReleases = DynamoSAP.Structure.Frame.SetReleases(fromEndPoints_3, set)
create_4 = List.Create(setLoad, setLoad_2, setReleases)
# note: ALL FRAMES IN THE PROJECT
flatten_10 = Flatten(create_4)
code_block_6 = CodeBlock { "Live_Load_Sample"; }
loadPatternTypes_3 = LoadPatternTypes("LTYPE_LIVE")
number_17 = DoubleInput(1.25)
setLoadPattern_3 = DynamoSAP.Definitions.LoadPattern.SetLoadPattern(code_block_6, loadPatternTypes_3, number_17)
# note: LOAD PATTERNS
create_5 = List.Create(setLoadPattern_3, setLoadPattern_2, setLoadPattern)
# note: ALL LOAD PATTERNS IN THE PROJECT
flatten_11 = Flatten(create_5)
code_block_7 = CodeBlock { "Load_Case_Sample"; }
number_18 = DoubleInput(1.2)
number_19 = DoubleInput(1.3)
number_20 = DoubleInput(1.2)
create_6 = List.Create(number_18, number_19, number_20)
loadCaseTypes = LoadCaseTypes("CASE_LINEAR_STATIC")
# note: LOAD CASE
setLoadCase = DynamoSAP.Definitions.LoadCase.SetLoadCase(code_block_7, create_5, create_6, loadCaseTypes)
create_7 = List.Create(setLoadCase)
# note: ALL LOAD CASES IN THE PROJECT
flatten_12 = Flatten(create_7)
number_21 = DoubleInput(0)
getItemAtIndex_8 = List.GetItemAtIndex(chop, number_21)
# note: RESTRAINTS
pinned = DynamoSAP.Definitions.Restraint.Pinned(getItemAtIndex_8)
create_8 = List.Create(pinned)
# note: ALL RESTRAINTS IN THE PROJECT
flatten_13 = Flatten(create_8)
# note: COLLECTOR
collector = DynamoSAP.Assembly.StructuralModel.Collector(flatten_10, flatten_11, flatten_12, flatten_13)
boolean_6 = BoolSelector(true)
units = Units("N_m_C")
# note: TRANSLATION INTO SAP
toSAP = DynamoSAP.Assembly.Bake.ToSAP(collector, boolean_6, units)
