# Dynamo graph simpletest.dyn (Dynamo 0.7.2.2921)

# note: Create Frame
byCoordinates = Point.ByCoordinates()
double_slider = DoubleSlider(47.119, range=0..100)
double_slider_2 = DoubleSlider(59.46, range=0..100)
byCoordinates_2 = Point.ByCoordinates(double_slider, double_slider_2)
code_block = CodeBlock { "Steel"; }
code_block_2 = CodeBlock { "W12x16"; }
integer_slider = IntegerSlider(4, range=0..7)
double_slider_3 = DoubleSlider(30, range=0..100)
fromEndPoints = DynamoSAP.Structure.Frame.FromEndPoints(byCoordinates, byCoordinates_2, code_block, code_block_2, integer_slider, double_slider_3)
code_block_3 = CodeBlock { "Ana_LiveLoad"; }
number = DoubleInput(3)
double_slider_4 = DoubleSlider(0, range=0..100)
setLoadPattern = DynamoSAP.Analysis.LoadPattern.SetLoadPattern(code_block_3, number, double_slider_4)
code_block_4 = CodeBlock { "Ana_DeadLoad"; }
number_2 = DoubleInput(1)
double_slider_5 = DoubleSlider(0, range=0..100)
setLoadPattern_2 = DynamoSAP.Analysis.LoadPattern.SetLoadPattern(code_block_4, number_2, double_slider_5)
create = List.Create(setLoadPattern, setLoadPattern_2)
createSAPModel = DynamoSAP.Assembly.SAPModel.CreateSAPModel(fromEndPoints, create)
watch = Watch(createSAPModel)
# note: Create Load Patterns
name = DynamoSAP.Analysis.LoadPattern.Name(setLoadPattern)
